# Grasshopper definition RozvanyDraw.gh (Grasshopper 1.0.7)
# plug-ins: Kangaroo2 Components, Karamba3D

pipeline = GeometryPipeline(
    GroupByLayer=False,
    GroupByType=False,
    IncludeHidden=True,
    IncludeLocked=True,
    LayerFilter="Clamped boundary",
    NameFilter="*",
    SublayerFiltering=False,
    TypeFilter=4)
pipeline_2 = GeometryPipeline(
    GroupByLayer=False,
    GroupByType=False,
    IncludeHidden=True,
    IncludeLocked=True,
    LayerFilter="Clamped interior",
    NameFilter="*",
    SublayerFiltering=False,
    TypeFilter=1)
pipeline_3 = GeometryPipeline(
    GroupByLayer=False,
    GroupByType=False,
    IncludeHidden=True,
    IncludeLocked=True,
    LayerFilter="Clamped interior",
    NameFilter="*",
    SublayerFiltering=False,
    TypeFilter=4)

arcpoints = GetPoint(AtLeast=0, AtMost=3, Realtime=True)  # disabled
linepoints = GetPoint(AtLeast=0, AtMost=2147483647, Realtime=True)  # disabled
boundarypoints = GetPoint(AtLeast=3, AtMost=2147483647, Realtime=True)
item = ListItem(List=arcpoints, Index=0, Wrap=True)  # -> Item, Item1, Item2
pline = PolyLine(Vertices=linepoints, Closed=False)  # -> simplify(Polyline)
pline_2 = PolyLine(Vertices=flatten(boundarypoints), Closed=invert(False))
arc = Arc3Pt(PointA=item.Item, PointB=item.Item1, PointC=item.Item2)  # -> simplify(Arc), Plane, Radius
len = Length(Curve=pline)

pipeline_4 = GeometryPipeline(
    GroupByLayer=False,
    GroupByType=False,
    IncludeHidden=True,
    IncludeLocked=True,
    LayerFilter="Clamped boundary",
    NameFilter="*",
    SublayerFiltering=False,
    TypeFilter=4)  # disabled
pipeline_5 = GeometryPipeline(
    GroupByLayer=False,
    GroupByType=False,
    IncludeHidden=True,
    IncludeLocked=True,
    LayerFilter="Clamped interior",
    NameFilter="*",
    SublayerFiltering=False,
    TypeFilter=1)  # disabled
pipeline_6 = GeometryPipeline(
    GroupByLayer=False,
    GroupByType=False,
    IncludeHidden=True,
    IncludeLocked=True,
    LayerFilter="Clamped interior",
    NameFilter="*",
    SublayerFiltering=False,
    TypeFilter=4)  # disabled

geo = Geometry([<point referenced from the Rhino model> x2])  # disabled
pline_3 = PolyLine(Vertices=geo, Closed=False)  # -> simplify(Polyline); disabled
colpoints = GetPoint(AtLeast=0, AtMost=2147483647, Realtime=True)

len_2 = Length(Curve=pipeline_6)  # disabled
number_slider = Slider(2, range=1..20)  # disabled
division = Division(A=len_2, B=number_slider)  # disabled
round = Round(Number=division)  # -> Nearest, Floor, Ceiling; disabled
divide = DivideCurve(Curve=simplify(graft(pipeline_6)), Count=simplify(graft(round.Nearest)), Kinks=False)  # -> Points, Tangents, Parameters; disabled
pline_4 = PolyLine(Vertices=divide.Points, Closed=False)  # disabled
pt = Point(divide.Points)  # disabled

explode = Explode(Curve=pipeline_4, Recursive=True)  # -> Segments, Vertices; disabled
len_3 = Length(Curve=explode.Segments)  # disabled
division_2 = Division(A=len_3, B=number_slider)  # disabled
round_2 = Round(Number=division_2)  # -> Nearest, Floor, Ceiling; disabled
divide_2 = DivideCurve(Curve=explode.Segments, Count=round_2.Nearest, Kinks=False)  # -> Points, Tangents, Parameters; disabled
pline_5 = PolyLine(Vertices=divide_2.Points, Closed=False)  # disabled
end = EndPoints(Curve=graft(pline_5))  # -> Start, End; disabled
crv = Curve(pline_5)  # disabled
merge = Merge(Data1=end.Start, Data2=end.End)  # disabled
pt_2 = Point(merge)  # disabled
pt_3 = Point(divide_2.Points)  # disabled

len_4 = Length(Curve=pline_3)  # disabled
pt_4 = Point(colpoints)
division_3 = Division(A=len_4, B=number_slider)  # disabled
round_3 = Round(Number=division_3)  # -> Nearest, Floor, Ceiling; disabled
divide_3 = DivideCurve(Curve=simplify(graft(pline_3)), Count=simplify(graft(round_3.Nearest)), Kinks=False)  # -> Points, Tangents, Parameters; disabled
pt_5 = Point(divide_3.Points)  # disabled
pt_6 = Point(pipeline_5)  # disabled
merge_2 = Merge(Data1=pt_5, Data2=pt)  # disabled
panel = Panel("""1
2""")
int = Integer(panel)
neg = Negative(Value=Slider(2, range=0..10))
number_slider_2 = Slider(0.5, range=0..1)
panel_2 = Panel("""1
2""")  # disabled
number_slider_3 = Slider(2, range=0..10)  # disabled
int_2 = Integer(panel_2)  # disabled
neg_2 = Negative(Value=number_slider_3)  # disabled
number_slider_4 = Slider(0.5, range=0..1)  # disabled
panel_3 = Panel("0")  # disabled
number_slider_5 = Slider(0.25, range=0..1)  # disabled
number_slider_6 = Slider(0.5, range=0..1)  # disabled

explode_2 = Explode(Curve=pline_2, Recursive=True)  # -> Segments, Vertices
len_5 = Length(Curve=explode_2.Segments)

len_6 = Length(Curve=arc.Arc)

spacing = GetNumber(Slider(10, range=10..20), AtLeast=1, AtMost=2147483647, Maximum=1.797693135e+308, Minimum=-1.797693135e+308)

division_4 = Division(A=len_6, B=spacing)
round_4 = Round(Number=division_4)  # -> Nearest, Floor, Ceiling
divide_4 = DivideCurve(Curve=simplify(graft(arc.Arc)), Count=simplify(graft(round_4.Nearest)), Kinks=False)  # -> Points, Tangents, Parameters
pline_6 = PolyLine(Vertices=divide_4.Points, Closed=False)
pt_7 = Point(divide_4.Points)

division_5 = Division(A=len_5, B=spacing)
round_5 = Round(Number=division_5)  # -> Nearest, Floor, Ceiling
divide_5 = DivideCurve(Curve=explode_2.Segments, Count=round_5.Nearest, Kinks=False)  # -> Points, Tangents, Parameters
pline_7 = PolyLine(Vertices=divide_5.Points, Closed=False)
pt_8 = Point(divide_5.Points)

division_6 = Division(A=len, B=spacing)
round_6 = Round(Number=division_6)  # -> Nearest, Floor, Ceiling
divide_6 = DivideCurve(Curve=simplify(graft(pline)), Count=simplify(graft(round_6.Nearest)), Kinks=False)  # -> Points, Tangents, Parameters
pline_8 = PolyLine(Vertices=divide_6.Points, Closed=False)
pt_9 = Point(divide_6.Points)
merge_3 = Merge(Data1=pt_9, Data2=pt_7)

entwine = Entwine(Branch0X=simplify(merge_3), Branch1X=simplify(graft(pt_4)), Branch2X=simplify(pt_8), FlattenInputs=False)

pt_10 = Point(entwine)

voronoi = Voronoi(Points=flatten(pt_10), BruteForceOverride=False)

unflatten = UnflattenTree(Tree=voronoi, Guide=pt_10)
runion = RegionUnion(Curves=unflatten)
trim = TrimWithRegion(Curve=runion, Region=pline_2)  # -> Inside, Outside
merge_4 = Merge(Data1=trim.Inside, Data2=pline_2)

entwine_2 = Entwine(Branch0X=simplify(merge_2), Branch1X=simplify(graft(pt_6)), Branch2X=simplify(pt_3), FlattenInputs=False)  # disabled

pt_11 = Point(entwine_2)  # disabled

voronoi_2 = Voronoi(Points=flatten(pt_11), BruteForceOverride=False)  # disabled

unflatten_2 = UnflattenTree(Tree=voronoi_2, Guide=pt_11)  # disabled
runion_2 = RegionUnion(Curves=unflatten_2)  # disabled
trim_2 = TrimWithRegion(Curve=runion_2, Region=pipeline_4)  # -> Inside, Outside; disabled
merge_5 = Merge(Data1=trim_2.Inside, Data2=pipeline_4)  # disabled

crv_2 = Curve(merge_4)
explode_3 = Explode(Curve=flatten(crv_2), Recursive=True)  # -> Segments, Vertices
dupln = RemoveDuplicateLines(Lines=flatten(explode_3.Segments), Tolerance=Slider(0.005, range=0..0.01))
join = JoinCurves(Curves=dupln, Preserve=False)
mcx = MultipleCurves(Curves=join)  # -> Points, IndexA, IndexB, ParamA, ParamB
Z = UnitZ(Factor=1)
line = LineSDL(Start=mcx.Points, Direction=Z, Length=1)
ccx = CurveCurve(CurveA=graft(crv_2), CurveB=line)  # -> Points, ParamsA, ParamsB
pshift = ShiftPaths(Data=simplify(ccx.ParamsA), Offset=-1)
shatter = Shatter(Curve=graft(crv_2), Parameters=pshift)
eval = EvaluateLength(Curve=flatten(shatter), Length=Slider(0.5, range=0..1), Normalized=True)  # -> Point, Tangent, Parameter
rdpoints = RemoveDuplicatePointsKaramba(Point=eval.Point, LimitDistance=Slider(0.05, range=0..1))  # -> OutPoint, Info, Indexes
cull_i = CullIndex(List=flatten(shatter), Indices=rdpoints.Indexes, Wrap=False)
eval_2 = EvaluateLength(Curve=flatten(cull_i), Length=Slider(0.5, range=0..1), Normalized=True)  # -> Point, Tangent, Parameter

merge_6 = Merge(Data1=cull_i, Data2=pline_6, Data3=pline_8, Data4=pline_2)  # -> flatten(Result)

len_7 = Length(Curve=merge_6)
division_7 = Division(A=len_7, B=spacing)
round_7 = Round(Number=division_7)  # -> Nearest, Floor, Ceiling
divide_7 = DivideCurve(Curve=merge_6, Count=round_7.Nearest, Kinks=False)  # -> Points, Tangents, Parameters

merge_7 = Merge(Data1=divide_7.Points, Data2=pt_4)
cullpt = CullDuplicates(Points=flatten(merge_7), Tolerance=0.1, CullMode=3)  # -> Points, Indices, Valence
voronoi_3 = Voronoi(Points=flatten(cullpt.Points), BruteForceOverride=False)

trim_3 = TrimWithRegion(Curve=voronoi_3, Region=pline_2)  # -> Inside, Outside
clean = CleanTree(RemoveNulls=True, RemoveInvalid=True, RemoveEmpty=False, Tree=trim_3.Inside)
entwine_3 = Entwine(Branch0X=simplify(divide_7.Points), Branch1X=simplify(graft(pt_4)), FlattenInputs=False)
crv_3 = Curve(clean)
incurve = PointInCurve(Point=graft(entwine_3), Curve=voronoi_3)  # -> Relationship, Point
mindex = MemberIndex(Set=incurve.Relationship, Member=int)  # -> Index, Count
item_2 = ListItem(List=voronoi_3, Index=mindex.Index, Wrap=True)
pshift_2 = ShiftPaths(Data=simplify(item_2), Offset=neg)
runion_3 = RegionUnion(Curves=pshift_2)  # -> flatten(Result)
explode_4 = Explode(Curve=runion_3, Recursive=True)  # -> flatten(Segments), Vertices
explode_5 = Explode(Curve=pshift_2, Recursive=True)  # -> flatten(Segments), Vertices
dupln_2 = RemoveDuplicateLines(Lines=explode_4.Segments, Tolerance=0.01)
dupln_3 = RemoveDuplicateLines(Lines=explode_5.Segments, Tolerance=0.01)
eval_3 = EvaluateLength(Curve=dupln_3, Length=number_slider_2, Normalized=True)  # -> Point, Tangent, Parameter
eval_4 = EvaluateLength(Curve=dupln_2, Length=number_slider_2, Normalized=True)  # -> Point, Tangent, Parameter
difference = SetDifference(SetA=eval_3.Point, SetB=eval_4.Point)
mindex_2 = MemberIndex(Set=eval_3.Point, Member=difference)  # -> flatten(Index), Count
cset = CreateSet(List=mindex_2.Index)  # -> Set, Map
item_3 = ListItem(List=dupln_3, Index=cset.Set, Wrap=False)
trim_4 = TrimWithRegion(Curve=item_3, Region=pline_2)  # -> Inside, Outside
geo_2 = Geometry(trim_4.Outside)
lng = ListLength(List=geo_2)
larger = LargerThan(FirstNumber=lng, SecondNumber="0")  # -> LargerThan, OrEqualTo
tstat = TreeStatistics(Tree=trim_4.Inside)  # -> Paths, Length, Count
dispatch = Dispatch(List=tstat.Paths, DispatchPattern=flatten(larger.LargerThan))  # -> ListA, ListB
branch = TreeBranch(Tree=trim_4.Inside, Path=dispatch.ListA, MaintainPaths=True)
branch_2 = TreeBranch(Tree=trim_4.Inside, Path=dispatch.ListB, MaintainPaths=True)
flip = FlipCurve(Curve=branch)  # -> Curve, Flag
dash = DashPattern(Curve=flip.Curve, Pattern=[Slider(10, range=0..16), Slider(5, range=0..16)])  # -> Dashes, Gaps
merge_8 = Merge(Data1=dash.Dashes, Data2=branch_2)

# ---- group: RH_OUT: curves
geo_3 = Geometry(merge_8)

# ----
crv_4 = Curve(merge_5)  # disabled
number_slider_7 = Slider(0.005, range=0..0.01)  # disabled
explode_6 = Explode(Curve=flatten(crv_4), Recursive=True)  # -> Segments, Vertices; disabled
dupln_4 = RemoveDuplicateLines(Lines=flatten(explode_6.Segments), Tolerance=number_slider_7)  # disabled
join_2 = JoinCurves(Curves=dupln_4, Preserve=False)  # disabled
mcx_2 = MultipleCurves(Curves=join_2)  # -> Points, IndexA, IndexB, ParamA, ParamB; disabled
Z_2 = UnitZ(Factor=1)  # disabled
line_2 = LineSDL(Start=mcx_2.Points, Direction=Z_2, Length=1)  # disabled
ccx_2 = CurveCurve(CurveA=graft(crv_4), CurveB=line_2)  # -> Points, ParamsA, ParamsB; disabled
pshift_3 = ShiftPaths(Data=simplify(ccx_2.ParamsA), Offset=-1)  # disabled
number_slider_8 = Slider(0.5, range=0..1)  # disabled
number_slider_9 = Slider(0.05, range=0..1)  # disabled
shatter_2 = Shatter(Curve=graft(crv_4), Parameters=pshift_3)  # disabled
eval_5 = EvaluateLength(Curve=flatten(shatter_2), Length=number_slider_8, Normalized=True)  # -> Point, Tangent, Parameter; disabled
rdpoints_2 = RemoveDuplicatePointsKaramba(Point=eval_5.Point, LimitDistance=number_slider_9)  # -> OutPoint, Info, Indexes; disabled
cull_i_2 = CullIndex(List=flatten(shatter_2), Indices=rdpoints_2.Indexes, Wrap=False)  # disabled
number_slider_10 = Slider(0.5, range=0..1)  # disabled
eval_6 = EvaluateLength(Curve=flatten(cull_i_2), Length=number_slider_10, Normalized=True)  # -> Point, Tangent, Parameter; disabled

merge_9 = Merge(Data1=cull_i_2, Data2=pline_4, Data3=pline_3)  # -> flatten(Result); disabled

len_8 = Length(Curve=merge_9)  # disabled
division_8 = Division(A=len_8, B=number_slider)  # disabled
round_8 = Round(Number=division_8)  # -> Nearest, Floor, Ceiling; disabled
divide_8 = DivideCurve(Curve=merge_9, Count=round_8.Nearest, Kinks=False)  # -> Points, Tangents, Parameters; disabled

merge_10 = Merge(Data1=divide_8.Points, Data2=pt_6)  # disabled
cullpt_2 = CullDuplicates(Points=flatten(merge_10), Tolerance=0.1, CullMode=3)  # -> Points, Indices, Valence; disabled
voronoi_4 = Voronoi(Points=flatten(cullpt_2.Points), BruteForceOverride=False)  # disabled

trim_5 = TrimWithRegion(Curve=voronoi_4, Region=pipeline_4)  # -> Inside, Outside; disabled
clean_2 = CleanTree(RemoveNulls=True, RemoveInvalid=True, RemoveEmpty=False, Tree=trim_5.Inside)  # disabled
entwine_4 = Entwine(Branch0X=simplify(divide_8.Points), Branch1X=simplify(graft(pt_6)), FlattenInputs=False)  # disabled
incurve_2 = PointInCurve(Point=graft(entwine_4), Curve=voronoi_4)  # -> Relationship, Point; disabled
mindex_3 = MemberIndex(Set=incurve_2.Relationship, Member=int_2)  # -> Index, Count; disabled
item_4 = ListItem(List=voronoi_4, Index=mindex_3.Index, Wrap=True)  # disabled
pshift_4 = ShiftPaths(Data=simplify(item_4), Offset=neg_2)  # disabled
runion_4 = RegionUnion(Curves=pshift_4)  # -> flatten(Result); disabled
explode_7 = Explode(Curve=runion_4, Recursive=True)  # -> flatten(Segments), Vertices; disabled
explode_8 = Explode(Curve=pshift_4, Recursive=True)  # -> flatten(Segments), Vertices; disabled
dupln_5 = RemoveDuplicateLines(Lines=explode_7.Segments, Tolerance=0.01)  # disabled
dupln_6 = RemoveDuplicateLines(Lines=explode_8.Segments, Tolerance=0.01)  # disabled
eval_7 = EvaluateLength(Curve=dupln_6, Length=number_slider_4, Normalized=True)  # -> Point, Tangent, Parameter; disabled
eval_8 = EvaluateLength(Curve=dupln_5, Length=number_slider_4, Normalized=True)  # -> Point, Tangent, Parameter; disabled
difference_2 = SetDifference(SetA=eval_7.Point, SetB=eval_8.Point)  # disabled
mindex_4 = MemberIndex(Set=eval_7.Point, Member=difference_2)  # -> flatten(Index), Count; disabled
cset_2 = CreateSet(List=mindex_4.Index)  # -> Set, Map; disabled
item_5 = ListItem(List=dupln_6, Index=cset_2.Set, Wrap=False)  # disabled
trim_6 = TrimWithRegion(Curve=item_5, Region=pipeline_4)  # -> Inside, Outside; disabled
geo_4 = Geometry(trim_6.Outside)  # disabled
lng_2 = ListLength(List=geo_4)  # disabled
geo_5 = Geometry(trim_6.Inside)  # disabled
tstat_2 = TreeStatistics(Tree=trim_6.Inside)  # -> Paths, Length, Count; disabled
larger_2 = LargerThan(FirstNumber=lng_2, SecondNumber=panel_3)  # -> LargerThan, OrEqualTo; disabled
dispatch_2 = Dispatch(List=tstat_2.Paths, DispatchPattern=flatten(larger_2.LargerThan))  # -> ListA, ListB; disabled
branch_3 = TreeBranch(Tree=trim_6.Inside, Path=dispatch_2.ListB, MaintainPaths=True)  # disabled
branch_4 = TreeBranch(Tree=trim_6.Inside, Path=dispatch_2.ListA, MaintainPaths=True)  # disabled
flip_2 = FlipCurve(Curve=branch_4)  # -> Curve, Flag; disabled
dash_2 = DashPattern(Curve=flip_2.Curve, Pattern=[number_slider_6, number_slider_5])  # -> Dashes, Gaps; disabled
