# Grasshopper definition RozvanyDraw01.gh (Grasshopper 1.0.7)
# plug-ins: Kangaroo2 Components

pipeline = GeometryPipeline(
    GroupByLayer=False,
    GroupByType=False,
    IncludeHidden=True,
    IncludeLocked=True,
    LayerFilter="Clamped boundary",
    NameFilter="*",
    SublayerFiltering=False,
    TypeFilter=4)
pipeline_2 = GeometryPipeline(
    GroupByLayer=False,
    GroupByType=False,
    IncludeHidden=True,
    IncludeLocked=True,
    LayerFilter="Clamped interior",
    NameFilter="*",
    SublayerFiltering=False,
    TypeFilter=1)
pipeline_3 = GeometryPipeline(
    GroupByLayer=False,
    GroupByType=False,
    IncludeHidden=True,
    IncludeLocked=True,
    LayerFilter="Clamped interior",
    NameFilter="*",
    SublayerFiltering=False,
    TypeFilter=4)

lnpoints = GetPoint(AtLeast=1, AtMost=2147483647, Realtime=True)
boundarypoints = GetPoint(AtLeast=3, AtMost=2147483647, Realtime=True)
item = ListItem(Index=0, Wrap=True)  # -> Item, Item1, Item2
pline = PolyLine(Vertices=flatten(lnpoints), Closed=False)  # -> simplify(Polyline)
pline_2 = PolyLine(Vertices=flatten(boundarypoints), Closed=invert(False))
arc = Arc3Pt(PointA=item.Item, PointB=item.Item1, PointC=item.Item2)  # -> simplify(Arc), Plane, Radius
len = Length(Curve=pline)
colpoints = GetPoint(AtLeast=0, AtMost=2147483647, Realtime=True)
pt = Point(colpoints)
panel = Panel("""1
2""")
int = Integer(panel)
neg = Negative(Value=Slider(2, range=0..10))
number_slider = Slider(0.5, range=0..1)
number_slider_2 = Slider(10, range=0..16)
number_slider_3 = Slider(5, range=0..16)

explode = Explode(Curve=pline_2, Recursive=True)  # -> Segments, Vertices
len_2 = Length(Curve=explode.Segments)

len_3 = Length(Curve=arc.Arc)
number_slider_4 = Slider(10, range=10..20)

spacing = GetNumber(number_slider_4, AtLeast=1, AtMost=2147483647, Maximum=1.797693135e+308, Minimum=-1.797693135e+308)

division = Division(A=len_3, B=spacing)
round = Round(Number=division)  # -> Nearest, Floor, Ceiling
divide = DivideCurve(Curve=simplify(graft(arc.Arc)), Count=simplify(graft(round.Nearest)), Kinks=False)  # -> Points, Tangents, Parameters
pline_3 = PolyLine(Vertices=divide.Points, Closed=False)
pt_2 = Point(divide.Points)

division_2 = Division(A=len_2, B=spacing)
round_2 = Round(Number=division_2)  # -> Nearest, Floor, Ceiling
divide_2 = DivideCurve(Curve=explode.Segments, Count=round_2.Nearest, Kinks=False)  # -> Points, Tangents, Parameters
pline_4 = PolyLine(Vertices=divide_2.Points, Closed=False)
pt_3 = Point(divide_2.Points)

division_3 = Division(A=len, B=spacing)
round_3 = Round(Number=division_3)  # -> Nearest, Floor, Ceiling
divide_3 = DivideCurve(Curve=simplify(graft(pline)), Count=simplify(graft(round_3.Nearest)), Kinks=False)  # -> Points, Tangents, Parameters
pline_5 = PolyLine(Vertices=divide_3.Points, Closed=False)
pt_4 = Point(divide_3.Points)
merge = Merge(Data1=pt_4, Data2=pt_2)

entwine = Entwine(Branch0X=simplify(divide_3.Points), Branch1X=simplify(graft(pt)), Branch2X=simplify(pt_3), FlattenInputs=False)

pt_5 = Point(entwine)

voronoi = Voronoi(Points=flatten(pt_5), BruteForceOverride=False)

unflatten = UnflattenTree(Tree=voronoi, Guide=pt_5)
runion = RegionUnion(Curves=unflatten)
trim = TrimWithRegion(Curve=runion, Region=pline_2)  # -> Inside, Outside
merge_2 = Merge(Data1=trim.Inside, Data2=pline_2)

crv = Curve(merge_2)
explode_2 = Explode(Curve=flatten(crv), Recursive=True)  # -> Segments, Vertices
dupln = RemoveDuplicateLines(Lines=flatten(explode_2.Segments), Tolerance=Slider(0.005, range=0..0.01))
join = JoinCurves(Curves=dupln, Preserve=False)
mcx = MultipleCurves(Curves=join)  # -> Points, IndexA, IndexB, ParamA, ParamB
Z = UnitZ(Factor=1)
line = LineSDL(Start=mcx.Points, Direction=Z, Length=1)
ccx = CurveCurve(CurveA=graft(crv), CurveB=line)  # -> Points, ParamsA, ParamsB
pshift = ShiftPaths(Data=simplify(ccx.ParamsA), Offset=-1)
shatter = Shatter(Curve=graft(crv), Parameters=pshift)
eval = EvaluateLength(Curve=flatten(shatter), Length=Slider(0.5, range=0..1), Normalized=True)  # -> Point, Tangent, Parameter

cullpt = CullDuplicates(Points=eval.Point, Tolerance=Slider(0.05, range=0..1), CullMode=1)  # -> Points, Indices, Valence

cull_i = CullIndex(List=flatten(shatter), Indices=cullpt.Indices, Wrap=False)
eval_2 = EvaluateLength(Curve=flatten(cull_i), Length=Slider(0.5, range=0..1), Normalized=True)  # -> Point, Tangent, Parameter

merge_3 = Merge(Data1=cull_i, Data2=pline_3, Data3=pline_5, Data4=pline_2)  # -> flatten(Result)

len_4 = Length(Curve=merge_3)
division_4 = Division(A=len_4, B=spacing)
round_4 = Round(Number=division_4)  # -> Nearest, Floor, Ceiling
divide_4 = DivideCurve(Curve=merge_3, Count=round_4.Nearest, Kinks=False)  # -> Points, Tangents, Parameters

merge_4 = Merge(Data1=divide_4.Points, Data2=pt)
cullpt_2 = CullDuplicates(Points=flatten(merge_4), Tolerance=0.1, CullMode=3)  # -> Points, Indices, Valence
voronoi_2 = Voronoi(Points=flatten(cullpt_2.Points), BruteForceOverride=False)

incurve = PointInCurve(Point=graft(pt), Curve=voronoi_2)  # -> Relationship, Point
trim_2 = TrimWithRegion(Curve=voronoi_2, Region=pline_2)  # -> Inside, Outside
mindex = MemberIndex(Set=incurve.Relationship, Member=2)  # -> Index, Count
clean = CleanTree(RemoveNulls=True, RemoveInvalid=True, RemoveEmpty=False, Tree=trim_2.Inside)
item_2 = ListItem(List=voronoi_2, Index=mindex.Index, Wrap=True)
entwine_2 = Entwine(Branch0X=simplify(divide_4.Points), Branch1X=simplify(graft(pt)), FlattenInputs=False)
crv_2 = Curve(clean)
len_5 = Length(Curve=item_2)
division_5 = Division(A=len_5, B=number_slider_4)
incurve_2 = PointInCurve(Point=graft(entwine_2), Curve=voronoi_2)  # -> Relationship, Point
round_5 = Round(Number=division_5)  # -> Nearest, Floor, Ceiling
divide_5 = DivideCurve(Curve=item_2, Count=round_5.Nearest, Kinks=False)  # -> Points, Tangents, Parameters
mindex_2 = MemberIndex(Set=incurve_2.Relationship, Member=int)  # -> Index, Count
ln = Line(StartPoint=graft(pt), EndPoint=divide_5.Points)  # -> flatten(Line)
item_3 = ListItem(List=voronoi_2, Index=mindex_2.Index, Wrap=True)
pshift_2 = ShiftPaths(Data=simplify(item_3), Offset=neg)
runion_2 = RegionUnion(Curves=pshift_2)  # -> flatten(Result)
explode_3 = Explode(Curve=runion_2, Recursive=True)  # -> flatten(Segments), Vertices
explode_4 = Explode(Curve=pshift_2, Recursive=True)  # -> flatten(Segments), Vertices
dupln_2 = RemoveDuplicateLines(Lines=explode_3.Segments, Tolerance=0.01)
dupln_3 = RemoveDuplicateLines(Lines=explode_4.Segments, Tolerance=0.01)
eval_3 = EvaluateLength(Curve=dupln_3, Length=number_slider, Normalized=True)  # -> Point, Tangent, Parameter
eval_4 = EvaluateLength(Curve=dupln_2, Length=number_slider, Normalized=True)  # -> Point, Tangent, Parameter
difference = SetDifference(SetA=eval_3.Point, SetB=eval_4.Point)
mindex_3 = MemberIndex(Set=eval_3.Point, Member=difference)  # -> flatten(Index), Count
cset = CreateSet(List=mindex_3.Index)  # -> Set, Map
item_4 = ListItem(List=dupln_3, Index=cset.Set, Wrap=False)
trim_3 = TrimWithRegion(Curve=item_4, Region=pline_2)  # -> Inside, Outside
geo = Geometry(trim_3.Outside)
lng = ListLength(List=geo)
larger = LargerThan(FirstNumber=lng, SecondNumber="0")  # -> LargerThan, OrEqualTo
tstat = TreeStatistics(Tree=trim_3.Inside)  # -> Paths, Length, Count
dispatch = Dispatch(List=tstat.Paths, DispatchPattern=flatten(larger.LargerThan))  # -> ListA, ListB
branch = TreeBranch(Tree=trim_3.Inside, Path=dispatch.ListA, MaintainPaths=True)
branch_2 = TreeBranch(Tree=trim_3.Inside, Path=dispatch.ListB, MaintainPaths=True)
flip = FlipCurve(Curve=branch)  # -> Curve, Flag
dash = DashPattern(Curve=graft(ln), Pattern=[number_slider_2, number_slider_3])  # -> Dashes, Gaps
dash_2 = DashPattern(Curve=flip.Curve, Pattern=[number_slider_2, number_slider_3])  # -> Dashes, Gaps
cull_i_2 = CullIndex(List=dash.Dashes, Indices=0, Wrap=True)
merge_5 = Merge(Data1=dash_2.Dashes, Data2=branch_2)

# ---- group: RH_OUT
geo_2 = Geometry([merge_5, cull_i_2])
